# Grasshopper definition daylight_guided_furniture_layout.gh (Grasshopper 1.0.7)

room = Curve(<curve referenced from the Rhino model>)
win = Curve([<curve referenced from the Rhino model> x2])
door = Curve(<curve referenced from the Rhino model>)

# ----
# 2. Furniture
#     types
bed = Curve(<curve referenced from the Rhino model>)
desk = Curve(<curve referenced from the Rhino model>)
lounge = Curve(<curve referenced from the Rhino model>)

# ----
# 1. Floor plan subdivision
explode = Explode(Curve=room, Recursive=True)  # -> Segments, Vertices
divlength = DivideLength(Curve=explode.Segments, Length="36")  # -> Points, Tangents, Parameters
hframe = HorizontalFrame(Curve=graft(explode.Segments), Parameter=divlength.Parameters)  # -> flatten(Frame)

# ----
# 3. Sides that snap on walls
explode_2 = Explode(Curve=bed, Recursive=True)  # -> reparameterize(Segments), Vertices
explode_3 = Explode(Curve=lounge, Recursive=True)  # -> reparameterize(Segments), Vertices
explode_4 = Explode(Curve=desk, Recursive=True)  # -> reparameterize(Segments), Vertices
hframe_2 = HorizontalFrame(Curve=explode_2.Segments, Parameter="0.5")
hframe_3 = HorizontalFrame(Curve=explode_3.Segments, Parameter="0.5")
hframe_4 = HorizontalFrame(Curve=explode_4.Segments, Parameter="0.5")
panel = Panel("""1
0""")
item = ListItem(List=hframe_4, Index="2", Wrap=True)
item_2 = ListItem(List=hframe_3, Index="3", Wrap=True)
cull_i = CullIndex(List=hframe_2, Indices=panel, Wrap=True)  # -> graft(List)

# ---- group: Position
number_slider = Slider(26, range=0..26)

# ----
# 4. Iterate arrangement combinations
# Collision detection
new_furniture = Curve(<curve referenced from the Rhino model>)
existing_crvs = Curve(<curve referenced from the Rhino model>)
orient = Orient(Geometry=bed, Source=cull_i, Target=hframe)  # -> Geometry, Transform
bang = ExplodeTree(Data=orient.Geometry)  # -> _0000, _0001, Branch2
disc = Discontinuity(Curve=existing_crvs, Level=1)  # -> Points, Parameters
incurve = PointInCurve(Point=disc.Points, Curve=new_furniture)  # -> Relationship, Point
item_3 = ListItem(List=bang._0001, Index=number_slider, Wrap=True)
equals = Equality(FirstNumber=incurve.Relationship, SecondNumber="2")  # -> Equality, Inequality
ma = MassAddition(Input=equals.Equality)  # -> Result, PartialResults
larger = LargerThan(FirstNumber=ma.Result, SecondNumber="0")  # -> LargerThan, OrEqualTo

# ----
# 5. Define Evaluation logic
area = Area(Geometry=win)  # -> Area, Centroid
area_2 = Area(Geometry=item_3)  # -> Area, Centroid
dist = Distance(PointA=area.Centroid, PointB=area_2.Centroid)
num_illuminance_proxy = Number(dist)

ln = Line(StartPoint=area.Centroid, EndPoint=area_2.Centroid)
